# Grasshopper definition Appserver1.gh (Grasshopper 1.0.7)
# Copyright: BiB in Paris, 2021
# plug-ins: Bifocals, Heron, Human, Pufferfish

mapbox_raster = MapboxRaster(
    Boundary=<missing>,
    ZoomLevel=<missing>,
    TargetFolder=<missing>,
    Prefix=<missing>,
    MapboxAccessToken=<missing>,
    Run=<missing>,
    MapboxSource="Mapbox Satellite",
    MapboxSourceList="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",
    MapboxURL="https://api.mapbox.com/v4/mapbox.satellite/{z}/{x}/{y}@2x.jpg90?access_token=",
    TileCacheMeta="19265621180606265653180625")  # -> ImageFile, ImageFrame, TileCount, MapboxAttribution

# ----
# CURVE INPUT FROM USER
curve = Curve(<curve referenced from the Rhino model>)
explode = Explode(Curve=curve, Recursive=True)  # -> Segments, Vertices
boundary_surfaces = BoundarySurfaces(Edges=explode.Segments)

panel = Panel("SITE")
dash_pattern = DashPattern(Curve=curve, Pattern=Slider(100, range=0..100))  # -> Dashes, Gaps
custom_preview_lineweights = CustomPreviewLineweights(
    Geometry=dash_pattern.Dashes,
    Shader=ColourSwatch(SwatchColor=RGB(255, 0, 0)),
    Thickness=Slider(5, range=0..10),
    Absolute=False)
# ANIMATE ME!!
number_slider = Slider(0, range=0..1500)
panel_2 = Panel("LOCATION POINT")

# ---- group: Size of panel(cm)
number_slider_2 = Slider(122, range=0..122)
number_slider_3 = Slider(0, range=0..20)

# ----
no_of_panels_2 = GetInteger(Slider(8, range=8..20), AtLeast=1, AtMost=2147483647, Maximum=359, Minimum=0)
no_of_panels_1 = GetInteger(Slider(8, range=8..20), AtLeast=1, AtMost=2147483647, Maximum=359, Minimum=0)

window_frame_thk = Panel("10")
window_frame_thk_2 = Panel("2")
window_frame_scale = Panel("0.92")

# ---- group: WALL THICKNESS(cm)
wall_thk = Slider(15, range=5..40)
wall_height = Panel("244")

# ---- group: Roof Thickness
roof_thk = Slider(15, range=0..25)
floor_thk = Slider(10, range=0..25)

# ---- group: Height of panels
Z = UnitZ(Factor=wall_height)

# ----
pt = Point(<point referenced from the Rhino model>)
building_center_point = GetPoint(pt, AtLeast=1, AtMost=2147483647, Realtime=True)
pdecon = Deconstruct(Point=building_center_point)  # -> XComponent, YComponent, ZComponent
pt_2 = ConstructPoint(XCoordinate=pdecon.XComponent, YCoordinate=pdecon.YComponent, ZCoordinate=0)

# ---- group: One panel
# *NOTA: 1 m2 = 10.764 Square foot
# SIP WOOD:17-30$/m2, here, 20$
# Wood window type Bay : 800-2700$, here 1000$
multiplication = Multiplication(A=number_slider_2, B=wall_height)
division = Division(A=multiplication, B="10000")
area_m2 = Panel(division)

# ----
rotation = GetInteger(Slider(0, range=0..359), AtLeast=1, AtMost=2147483647, Maximum=359, Minimum=0)
number_slider_4 = Slider(2557, range=0..10000)
unit_x = UnitX(Factor=expr("-x", number_slider_4))
unit_y = UnitY(Factor=number_slider_4)
panel_3 = Panel("DATA ")
amplitude = Amplitude(Vector=[unit_y, unit_x], Amplitude=1)
mesh_daylight_autonomy_result = Mesh()  # disabled
mesh_energy_simulation_graph = Geometry()  # disabled

# ----
# HOUSE POSITION
# *NOTA: Construction time SIP house:
# 8 days.
# Let's say, general house size 65m2.
# 65m2 / 8days = 8.125 m2 / 1 day
# FLOOR & ROOF
panel_4 = Panel("1.0")
# WINDOW POSITION
random = Random(Range=panel_4, Number=4, Seed=number_slider)  # -> simplify(graft(Random))
panel_5 = Panel("PRE-FAB MODELS")
explode_tree = ExplodeTree(Data=random)  # -> Branch0, Branch1, Branch2, Branch3
panel_6 = Panel(random)
series = Series(Start=number_slider_3, Step=number_slider_2, Count=no_of_panels_1)
series_2 = Series(Start=number_slider_3, Step=number_slider_2, Count=no_of_panels_2)
unit_z = UnitZ(Factor="10")
pt_3 = ConstructPoint(XCoordinate=0, YCoordinate=series, ZCoordinate=0)
unit_z_2 = UnitZ(Factor="10")
pt_4 = ConstructPoint(XCoordinate=series_2, YCoordinate=0, ZCoordinate=0)
move = Move(Geometry=pt_3, Motion=unit_z)  # -> Geometry, Transform
move_2 = Move(Geometry=pt_4, Motion=unit_z_2)  # -> Geometry, Transform
lng = ListLength(List=move.Geometry)  # -> expr("-1", Length)
lng_2 = ListLength(List=move_2.Geometry)  # -> expr("-1", Length)
item = ListItem(List=move.Geometry, Index=lng, Wrap=True)
pt_5 = ConstructPoint(XCoordinate=series_2, YCoordinate=item, ZCoordinate=0)
item_2 = ListItem(List=move_2.Geometry, Index=lng_2, Wrap=True)
cluster = Cluster(L_3=pt_5, L=pt_5, L_4=pt_5, L_5=move_2.Geometry, L_2=move_2.Geometry, L_6=move_2.Geometry)  # -> i, i_2, i_3, i_4
unit_z_3 = UnitZ(Factor="10")
pt_6 = ConstructPoint(XCoordinate=item_2, YCoordinate=series, ZCoordinate=0)
wall3 = WALL3(
    factor=window_frame_thk,
    factor_2=window_frame_thk_2,
    w_frame_scale=window_frame_scale,
    split_values=explode_tree.Branch2,
    point=move_2.Geometry,
    wall_height=wall_height,
    wall_thickness_yaxis=wall_thk)  # -> w_panel_frame, w_panel, w_panel_surface_for_simulation, window_frame_for_simulation, wall_surface_for_simulation, walls
wall_1 = WALL1(
    window_frame_thk=window_frame_thk,
    window_panel_thk=window_frame_thk_2,
    w_frame_scale=window_frame_scale,
    split_values=explode_tree.Branch0,
    point=move.Geometry,
    wall_height=wall_height,
    wall_thickness=wall_thk)  # -> w_panel_frame, w_panel, w_panel_surface_for_simulation, window_frame_for_simulation, wall_surface_for_simulation, walls
wall2 = WALL2(
    window_frame_thk=window_frame_thk,
    window_panel_thk=window_frame_thk_2,
    w_frame_scale=window_frame_scale,
    split_values=explode_tree.Branch1,
    point=pt_6,
    wall_height=wall_height,
    wall_thickness=wall_thk)  # -> w_panel_frame, w_panel, w_panel_surface_for_simulation, window_frame_for_simulation, wall_surface_for_simulation, walls
wall4 = WALL4(
    window_frame_thk=window_frame_thk,
    window_panel_thk=window_frame_thk_2,
    w_frame_scale=window_frame_scale,
    split_values=explode_tree.Branch3,
    point=pt_5,
    wall_height=wall_height,
    wall_thickness=wall_thk)  # -> w_panel_frame, w_panel, w_panel_surface_for_simulation, window_frame_for_simulation, wall_surface_for_simulation, walls
win_frame1 = Geometry(wall_1.w_panel_frame)
window1 = Geometry(wall_1.w_panel)
wall1 = Geometry(wall_1.walls)
win_frame2 = Geometry(wall2.w_panel_frame)
window2 = Geometry(wall2.w_panel)
wall2_2 = Geometry(wall2.walls)
win_frame3 = Geometry(wall3.w_panel_frame)
window3 = Geometry(wall3.w_panel)
win_frame4 = Geometry(wall4.w_panel_frame)
window4 = Geometry(wall4.w_panel)
wall4_2 = Geometry(wall4.walls)
wall3_2 = Geometry(wall3.walls)
lng_3 = ListLength(List=wall4_2)
lng_4 = ListLength(List=window1)
lng_5 = ListLength(List=wall1)
lng_6 = ListLength(List=window2)
lng_7 = ListLength(List=wall2_2)
lng_8 = ListLength(List=win_frame3)
lng_9 = ListLength(List=wall3_2)
lng_10 = ListLength(List=window4)

# ---- group: Number of Panels
addition = Addition(A=lng_4, B=lng_6, C=lng_8, D=lng_10)
total_windows_number = Panel(addition)

addition_2 = Addition(A=lng_5, B=lng_7, C=lng_9, D=lng_3)
total_wall_panels_number = Panel(addition_2)

# ---- group: Floor & Roof
srf4pt = _4PointSurface(CornerA=cluster.i, CornerB=cluster.i_2, CornerC=cluster.i_4, CornerD=cluster.i_3)
Z_2 = UnitZ(Factor=expr("-x", floor_thk))
Z_3 = UnitZ(Factor=roof_thk)
roof = Panel("1.1")

# ----
move_3 = Move(Geometry=srf4pt, Motion=unit_z_3)  # -> Geometry, Transform
extr = Extrude(Base=move_3.Geometry, Direction=Z_2)
floor = Geometry(extr)
expression = Expression(x=addition, Expression="x * 1000")

# ---- group: Floor & Roof (continued)
move_4 = Move(Geometry=move_3.Geometry, Motion=Z)  # -> Geometry, Transform
area = Area(Geometry=move_4.Geometry)  # -> Area, Centroid
scale = Scale(Geometry=move_4.Geometry, Center=area.Centroid, Factor=roof)  # -> Geometry, Transform
extr_2 = Extrude(Base=scale.Geometry, Direction=Z_3)

# ----
roof_2 = Geometry(extr_2)
merge = Merge(
    Data1=win_frame1,
    Data2=window1,
    Data3=wall1,
    Data4=win_frame2,
    Data5=window2,
    Data6=wall2_2,
    Data7=win_frame3,
    Data8=window3,
    Data9=wall3_2,
    Data10=win_frame4,
    Data11=window4,
    Data12=wall4_2,
    Data13=roof_2,
    Data14=floor)

brec = BoundingRectangle(Geometry=flatten(merge), Plane=PlaneXY(0, 0, 0), Axis=0, Slide=0, Union=True)  # -> Bounding, DimensionX, DimensionY
area_2 = Area(Geometry=brec.Bounding)  # -> Area, Centroid

dimensions = Dimensions(Surface=move_3.Geometry)  # -> UDimension, VDimension
division_2 = Division(A=dimensions.UDimension, B="100")
division_3 = Division(A=dimensions.VDimension, B="100")
length_x_m = Panel(division_2)
# 5. Point-in-time Illuminance
# 4. Daylight Autonomy
# 6. Annual Sunlight Exposure
length_y_m = Panel(division_3)

# ---- group: Area Calculation
area_3 = Area(Geometry=move_4.Geometry)  # -> Area, Centroid
division_4 = Division(A=area_3.Area, B="10000")
area_m2_2 = Panel(division_4)

# ----
vec2pt = Vector2Pt(PointA=area_2.Centroid, PointB=pt_2, Unitize=False)  # -> Vector, Length
move_5 = Move(Geometry=merge, Motion=vec2pt.Vector)  # -> Geometry, Transform
rotate = Rotate(Geometry=move_5.Geometry, Angle=degrees(rotation), Plane=pt_2)  # -> Geometry, Transform

multiplication_2 = Multiplication(A=total_wall_panels_number, B=area_m2)
expression_2 = Expression(x=multiplication_2, Expression="x * 10.764 * 20")
integer = Integer(expression_2)
mass_addition = MassAddition(Input=[integer, expression])  # -> Result, PartialResults
total_construction_cost = Panel(mass_addition.Result)

final_geometry = Geometry(rotate.Geometry)
bounding_box = BoundingBox(Content=final_geometry, Plane=PlaneXY(0, 0, 0), UnionBox=True)  # -> Box, Box_2
project = Project(Geometry=bounding_box.Box, Plane=PlaneXY(0, 0, 0))  # -> Geometry, Transform
# Important toggle
brep_wireframe = BrepWireframe(Brep=project.Geometry, Density=-1)
# NOTE
join_curves = JoinCurves(Curves=brep_wireframe, Preserve=False)
list_item = ListItem(List=flatten(join_curves), Index=0, Wrap=True)
curve_2 = Curve(list_item)
discontinuity = Discontinuity(Curve=curve_2, Level=1)  # -> Points, Parameters
point_in_curve = PointInCurve(Point=discontinuity.Points, Curve=curve)  # -> Relationship, Point
list_length = ListLength(List=discontinuity.Points)
boolean = Boolean(point_in_curve.Relationship)
mass_addition_2 = MassAddition(Input=boolean)  # -> Result, PartialResults
larger_than = LargerThan(FirstNumber=mass_addition_2.Result, SecondNumber=list_length)  # -> LargerThan, OrEqualTo
move_6 = Move(Geometry=final_geometry, Motion=amplitude)  # -> Geometry, Transform
panel_7 = Panel(larger_than.OrEqualTo)
stream_filter = StreamFilter(Gate=larger_than.OrEqualTo, Stream0=move_6.Geometry, Stream1=final_geometry)

# ---- group: Feature
len_x = Data(division_2)
# sDA
# DA
# ASE
# ASE
len_y = Data(length_y_m)

# ---- group: Geometry output
brep = Brep(simplify(stream_filter))
brep_wireframe_2 = BrepWireframe(Brep=brep, Density=-1)
create_material = CreateMaterial(
    Diffuse=ColourSwatch(SwatchColor=RGB(255, 255, 255)),
    Specular=RGB(255, 255, 255),
    Emission=RGB(0, 0, 0),
    Transparency=Slider(0.84, range=0..1),
    Shine=0)
custom_preview_lineweights_2 = CustomPreviewLineweights(Geometry=brep_wireframe_2, Shader=ColourSwatch(SwatchColor=RGB(0, 0, 0)), Thickness=2, Absolute=False)

# ----
explode_tree_2 = ExplodeTree(Data=brep)  # -> Branch0, _0000

# ---- group: Geometry output / RH_OUT:Roof_base
# TITLE
# GENERATIVE OUTPUT
# ERROR
# QUESTION
# OUTPUT
# INPUT
custom_preview = CustomPreview(Geometry=explode_tree_2.Branch0, Material=create_material)

# ---- group: RH_OUT:walls
custom_preview_2 = CustomPreview(Geometry=explode_tree_2._0000, Material=ColourSwatch(SwatchColor=RGB(255, 197, 135)))

# ----
expression_3 = Expression(x=division_4, Expression="x / 8.125")

# ---- group: Integer
ghpython_script = GhPythonScript(R=expression_3)  # -> out; disabled
# ---------- ghpython_script: Python ----------
import Rhino.Geometry as rg

if R < 1:
    print(int(1))
else: 
    print(R)
# ---------- end ghpython_script ----------
integer_2 = Integer(expression_3)

# ----
construction_time_days = Panel(integer_2)

minimize_electricity_consumption = Number()  # disabled
wlc_minimize_construction_cost = Number(mass_addition.Result)  # disabled
construction_time = Number(integer_2)  # disabled
ase = Number()  # disabled
area_4 = Number(division_4)  # disabled
sda = Number()  # disabled

integer_3 = Integer(minimize_electricity_consumption)  # disabled
integer_4 = Integer(sda)  # disabled
panel_8 = Panel(area_4)  # disabled
panel_9 = Panel(construction_time)  # disabled
panel_10 = Panel(wlc_minimize_construction_cost)  # disabled
panel_11 = Panel(integer_3)  # disabled
panel_12 = Panel(integer_4)  # disabled
panel_13 = Panel(ase)  # disabled

# ----
# C:\Users\kimky\Google Drive\Module_3_GROUP6 FOLDER\S2.Data Encoding - Babi and Kim\1st_dataset_windowPMV.csv
labels = Panel("""City
Area
Construction_Time
Construction_Cost
Electricity_Consumption
sDA""")  # disabled
merge_2 = Merge(
    Data1=flatten(area_4),
    Data2=flatten(construction_time),
    Data3=flatten(wlc_minimize_construction_cost),
    Data4=flatten(integer_3),
    Data5=flatten(integer_4))  # disabled
ghpython_script_2 = GhPythonScript()  # -> out; disabled
# ---------- ghpython_script_2: Python ----------
import Rhino.Geometry as rg

if x == 0:
    print("Paris")
elif x == 1:
    print("San_Paulo")
else:
    print("Concepcion")
# ---------- end ghpython_script_2 ----------
list_length_2 = ListLength(List=merge_2)  # disabled
panel_14 = Panel(" ")  # disabled
panel_15 = Panel(ghpython_script_2)  # disabled
join = TextJoin(Text=labels, Join=panel_14)  # disabled
workingdir = Panel("C:\Users\kimky\Desktop\tmp\DATASET V2_studio.csv")  # disabled
panel_16 = Panel(" ")  # disabled
insert_items = InsertItems(List=merge_2, Item=panel_15, Indices=expr("x+1", list_length_2), Wrap=True)  # disabled
join_2 = TextJoin(Text=insert_items, Join=panel_16)  # disabled
toggle = BooleanToggle(True)  # disabled
panel_17 = Panel(insert_items)  # disabled
num = Number(number_slider)  # disabled
export_robotmotion_3_r3_multi = PythonScript(toggle=toggle, path=workingdir, x=join_2, labs=join, y=num)  # disabled
# ---------- export_robotmotion_3_r3_multi: Python ----------
#script by Gabriella Rossi / CITA
import os
from os import listdir
from os.path import isfile, join
from scriptcontext import sticky as st

if True:
    #Create file
    filename = str(path)
    fil = open(filename, 'a+')
    
    if y < 1 :

        #write header and first line
        fil.write(labs)
        fil.write('\n' + x)
    else:
        #just write line
        fil.write('\n' + x)

    fil.close()
# ---------- end export_robotmotion_3_r3_multi ----------

# ----
# Phenotype
area_5 = Area(Geometry=boundary_surfaces)  # -> Area, Centroid
# Illuminance
# sDA - no blinds
# (Spatial Daylight Autonomy)
# ASE
mesh_ase_simulation_result = Mesh()  # disabled
building = Geometry(move_5.Geometry)  # disabled
site = Mesh(boundary_surfaces)  # disabled
entwine = Entwine(Branch00=building, Branch01=site, FlattenInputs=True)  # -> simplify(flatten(Result)); disabled

division_5 = Division(A=area_5.Area, B="10000")
site_surface_m2 = Panel(division_5)

ma = MassAddition(Input=flatten(division_5))  # -> Result, PartialResults
total_site_area = Number(ma.Result)

# ==== cluster WALL1
window_frame_thk = ClusterInput()
window_panel_thk = ClusterInput()

# ---- group: Cluster Input
wall_thickness = ClusterInput()

# ----
w_frame_scale = ClusterInput()

# ---- group: Cluster Input
wall_height = ClusterInput()

# ----
split_values = ClusterInput()

# ---- group: Cluster Input
point = ClusterInput()

# ----
Z = UnitZ(WallHeight=wall_height)
move = Move(Geometry=point, Motion=Z)  # -> Geometry, Transform
shift = ShiftList(List=move.Geometry, Shift=1, Wrap=True)
box = Box2Pt(PointA=point, PointB=shift, Plane=PlaneXY(0, 0, 0))
cull_i = CullIndex(List=box, Indices=-1, Wrap=True)
X = UnitX(WallThickness=wall_thickness)

X_2 = UnitX(WindowFrameTHK=window_frame_thk)
X_3 = UnitX(WindowPanelTHK=window_panel_thk)
random_split_list = RandomSplitList(MasterList=cull_i, Seed=50, SplitValues=split_values)  # -> WindowFrameForSimulation, WallSurfaceForSimulation
panel_frame = PanelFrame(Panel=random_split_list.WindowFrameForSimulation, WFrameScale=w_frame_scale)  # -> WPanelFrame, WPanelSurfaceForSimulation
extrude = Extrude(Base=random_split_list.WallSurfaceForSimulation, Direction=X)
is_planar = IsPlanar(Surface=panel_frame.WPanelSurfaceForSimulation, Interior=True)  # -> Planar, Plane
plane_normal = PlaneNormal(Origin=Point(0, 0, 0), ZAxis=is_planar.Plane)
extrude_2 = Extrude(Base=panel_frame.WPanelFrame, Direction=X_2)
amplitude = Amplitude(Vector=plane_normal, Amplitude="4")
move_2 = Move(Geometry=panel_frame.WPanelSurfaceForSimulation, Motion=amplitude)  # -> Geometry, Transform
extrude_3 = Extrude(Base=move_2.Geometry, Direction=X_3)
w_panel_surface_for_simulation = ClusterOutput(panel_frame.WPanelSurfaceForSimulation)
window_frame_for_simulation = ClusterOutput(random_split_list.WindowFrameForSimulation)
w_panel_frame = ClusterOutput(extrude_2)
w_panel = ClusterOutput(extrude_3)
wall_surface_for_simulation = ClusterOutput(random_split_list.WallSurfaceForSimulation)

# ---- group: Cluster Output
walls = ClusterOutput(extrude)

# ==== cluster WALL3
factor = ClusterInput()
factor_2 = ClusterInput()
w_frame_scale = ClusterInput()
split_values = ClusterInput()

# ---- group: Cluster Input
wall_height = ClusterInput()

wall_thickness_yaxis = ClusterInput()

point = ClusterInput()

# ----
Z = UnitZ(WallHeight=wall_height)
move = Move(Geometry=point, Motion=Z)  # -> Geometry, Transform
shift = ShiftList(List=move.Geometry, Shift=1, Wrap=True)
box = Box2Pt(PointA=point, PointB=shift, Plane=PlaneXY(0, 0, 0))
cull_i = CullIndex(List=box, Indices=-1, Wrap=True)

unit_y = UnitY(Factor=factor)
unit_y_2 = UnitY(Factor=factor_2)
unit_y_3 = UnitY(WallThicknessYaxis=wall_thickness_yaxis)
random_split_list = RandomSplitList(MasterList=cull_i, Seed=50, SplitValues=split_values)  # -> WindowFrameForSimulation, WallSurfaceForSimulation
panel_frame = PanelFrame(Panel=random_split_list.WindowFrameForSimulation, WFrameScale=w_frame_scale)  # -> WPanelFrame, WPanelSurfaceForSimulation
extrude = Extrude(Base=random_split_list.WallSurfaceForSimulation, Direction=unit_y_3)
is_planar = IsPlanar(Surface=panel_frame.WPanelSurfaceForSimulation, Interior=True)  # -> Planar, Plane
plane_normal = PlaneNormal(Origin=Point(0, 0, 0), ZAxis=is_planar.Plane)
amplitude = Amplitude(Vector=plane_normal, Amplitude=expr("-x", "4"))
extrude_2 = Extrude(Base=panel_frame.WPanelFrame, Direction=unit_y)
move_2 = Move(Geometry=panel_frame.WPanelSurfaceForSimulation, Motion=amplitude)  # -> Geometry, Transform
extrude_3 = Extrude(Base=move_2.Geometry, Direction=unit_y_2)
w_panel_surface_for_simulation = ClusterOutput(panel_frame.WPanelSurfaceForSimulation)
window_frame_for_simulation = ClusterOutput(random_split_list.WindowFrameForSimulation)
wall_surface_for_simulation = ClusterOutput(random_split_list.WallSurfaceForSimulation)
w_panel_frame = ClusterOutput(extrude_2)
w_panel = ClusterOutput(extrude_3)

# ---- group: Cluster Output
walls = ClusterOutput(extrude)

# ==== cluster Cluster
L = ClusterInput()
L_2 = ClusterInput()
lng = ListLength(List=L)  # -> expr("-1", Length)
lng_2 = ListLength(List=L_2)  # -> expr("-1", Length)
L_3 = ClusterInput()
L_4 = ClusterInput()
L_5 = ClusterInput()
L_6 = ClusterInput()
item = ListItem(List=L_3, Index=lng, Wrap=True)
item_2 = ListItem(List=L_4, Index=0, Wrap=True)
item_3 = ListItem(List=L_5, Index=lng_2, Wrap=True)
item_4 = ListItem(List=L_6, Index=0, Wrap=True)
i = ClusterOutput(item)
i_2 = ClusterOutput(item_2)
i_3 = ClusterOutput(item_3)
i_4 = ClusterOutput(item_4)

# ==== cluster WALL2
window_frame_thk = ClusterInput()
window_panel_thk = ClusterInput()
wall_thickness = ClusterInput()
w_frame_scale = ClusterInput()
wall_height = ClusterInput()
split_values = ClusterInput()
point = ClusterInput()
Z = UnitZ(WallHeight=wall_height)
move = Move(Geometry=point, Motion=Z)  # -> Geometry, Transform
shift = ShiftList(List=move.Geometry, Shift=1, Wrap=True)
box = Box2Pt(PointA=point, PointB=shift, Plane=PlaneXY(0, 0, 0))
cull_i = CullIndex(List=box, Indices=-1, Wrap=True)
X = UnitX(WindowFrameTHK=expr("-x", window_frame_thk))
X_2 = UnitX(WallThickness=expr("-x", wall_thickness))
X_3 = UnitX(WindowPanelTHK=expr("-x", window_panel_thk))
is_planar = IsPlanar(Surface=cull_i, Interior=True)  # -> Planar, Plane
plane_normal = PlaneNormal(Origin=Point(0, 0, 0), ZAxis=is_planar.Plane)
amplitude = Amplitude(Vector=plane_normal, Amplitude="15")
random_split_list = RandomSplitList(MasterList=cull_i, Seed=50, SplitValues=split_values)  # -> WindowFrameForSimulation, WallSurfaceForSimulation
move_2 = Move(Geometry=cull_i, Motion=amplitude)  # -> Geometry, Transform
panel_frame = PanelFrame(Panel=random_split_list.WindowFrameForSimulation, WFrameScale=w_frame_scale)  # -> WPanelFrame, WPanelSurfaceForSimulation
extrude = Extrude(Base=random_split_list.WallSurfaceForSimulation, Direction=X_2)
is_planar_2 = IsPlanar(Surface=panel_frame.WPanelSurfaceForSimulation, Interior=True)  # -> Planar, Plane
plane_normal_2 = PlaneNormal(Origin=Point(0, 0, 0), ZAxis=is_planar_2.Plane)
amplitude_2 = Amplitude(Vector=expr("-x", plane_normal_2), Amplitude="4")
extrude_2 = Extrude(Base=panel_frame.WPanelFrame, Direction=X)
move_3 = Move(Geometry=panel_frame.WPanelSurfaceForSimulation, Motion=amplitude_2)  # -> Geometry, Transform
extrude_3 = Extrude(Base=move_3.Geometry, Direction=X_3)
w_panel_frame = ClusterOutput(extrude_2)
w_panel_surface_for_simulation = ClusterOutput(panel_frame.WPanelSurfaceForSimulation)
w_panel = ClusterOutput(extrude_3)
window_frame_for_simulation = ClusterOutput(random_split_list.WindowFrameForSimulation)
wall_surface_for_simulation = ClusterOutput(random_split_list.WallSurfaceForSimulation)
walls = ClusterOutput(extrude)

# ==== cluster WALL4
window_frame_thk = ClusterInput()
window_panel_thk = ClusterInput()

# ---- group: Cluster Input
wall_thickness = ClusterInput()

# ----
w_frame_scale = ClusterInput()

# ---- group: Cluster Input
wall_height = ClusterInput()

# ----
split_values = ClusterInput()

# ---- group: Cluster Input
point = ClusterInput()

# ----
Z = UnitZ(WallHeight=wall_height)
move = Move(Geometry=point, Motion=Z)  # -> Geometry, Transform
shift = ShiftList(List=move.Geometry, Shift=1, Wrap=True)
box = Box2Pt(PointA=point, PointB=shift, Plane=PlaneXY(0, 0, 0))
unit_y = UnitY(WallThickness=expr("-x", wall_thickness))
unit_y_2 = UnitY(WindowFrameTHK=expr("-x", window_frame_thk))
unit_y_3 = UnitY(WindowPanelTHK=expr("-x", window_panel_thk))
cull_i = CullIndex(List=box, Indices=-1, Wrap=True)
is_planar = IsPlanar(Surface=cull_i, Interior=True)  # -> Planar, Plane
plane_normal = PlaneNormal(Origin=Point(0, 0, 0), ZAxis=is_planar.Plane)
amplitude = Amplitude(Vector=plane_normal, Amplitude="15")
random_split_list = RandomSplitList(MasterList=cull_i, Seed=50, SplitValues=split_values)  # -> WindowFrameForSimulation, WallSurfaceForSimulation
move_2 = Move(Geometry=cull_i, Motion=amplitude)  # -> Geometry, Transform
panel_frame = PanelFrame(Panel=random_split_list.WindowFrameForSimulation, WFrameScale=w_frame_scale)  # -> WPanelFrame, WPanelSurfaceForSimulation
extrude = Extrude(Base=random_split_list.WallSurfaceForSimulation, Direction=unit_y)
is_planar_2 = IsPlanar(Surface=panel_frame.WPanelSurfaceForSimulation, Interior=True)  # -> Planar, Plane
plane_normal_2 = PlaneNormal(Origin=Point(0, 0, 0), ZAxis=is_planar_2.Plane)
amplitude_2 = Amplitude(Vector=plane_normal_2, Amplitude="4")
extrude_2 = Extrude(Base=panel_frame.WPanelFrame, Direction=unit_y_2)
move_3 = Move(Geometry=panel_frame.WPanelSurfaceForSimulation, Motion=amplitude_2)  # -> Geometry, Transform
extrude_3 = Extrude(Base=move_3.Geometry, Direction=unit_y_3)
w_panel_surface_for_simulation = ClusterOutput(panel_frame.WPanelSurfaceForSimulation)
window_frame_for_simulation = ClusterOutput(random_split_list.WindowFrameForSimulation)
wall_surface_for_simulation = ClusterOutput(random_split_list.WallSurfaceForSimulation)
w_panel_frame = ClusterOutput(extrude_2)
w_panel = ClusterOutput(extrude_3)

# ---- group: Cluster Output
walls = ClusterOutput(extrude)
