# Grasshopper definition Assignment3.gh (Grasshopper 1.0.7)
# Copyright: Creative commons license
# plug-ins: Mesh Pipe

# ---- group: RH_IN:radius1
number_slider = Slider(10, range=1..20)

# ----
pt = ConstructPoint(XCoordinate=0, YCoordinate=0, ZCoordinate=0)

# ---- group: RH_IN:loops
number_slider_2 = Slider(48, range=1..100)

# ---- group: RH_IN:seed
number_slider_3 = Slider(1, range=1..5)

# ----
sph = Sphere(Base=pt, Radius=number_slider)
bbox = BoundingBox(Content=sph, Plane=PlaneXY(0, 0, 0), UnionBox=True)  # -> Box, Box_2

# ---- group: RH_IN:planedir
number_slider_4 = Slider(6, range=1..10)

# ----
pop3d = Populate3D(Region=bbox.Box, Count=number_slider_2, Seed=number_slider_3)
ln = Line(StartPoint=pt, EndPoint=pop3d)
list = ValueList({"1st": 0, "2nd": 0.2, "3rd": 0.4, "4th": 0.6, "5th": 0.85, "6th": 1.0}, selected="4th")  # disabled
division = Division(A=number_slider_4, B=10)
pframe = PerpFrame(Curve=ln, Parameter=division)
toggle = BooleanToggle(False)  # disabled

# ---- group: RH_IN:radius2
number_slider_5 = Slider(1, range=1..4)

# ----
sec = BrepPlane(Brep=sph, Plane=pframe)  # -> Curves, Points
panel = Panel("""0.2
0.4""")  # disabled
item = ListItem(List=panel, Index=toggle, Wrap=True)  # disabled
division_2 = Division(A=number_slider_5, B=10)
mpipe = MeshPipe(Curve=flatten(sec.Curves), Radius=division_2, Accuracy=0.2, Rotation=0, Segments=10, Caps=2)
pipe = Pipe(Curve=sec.Curves, Radius=division_2, Caps=0)
medges = MeshEdges(Mesh=pipe)  # -> NakedEdges, InteriorEdges, NonManifoldEdges

# ---- group: RH_OUT:edges
crv = Curve(medges.InteriorEdges)

# ---- group: RH_OUT:mesh
mesh = Mesh(pipe)
