# Grasshopper definition Assignment4.gh (Grasshopper 1.0.7)
# Copyright: Creative commons license
# plug-ins: Mesh Pipe

# ---- group: RH_IN:radius1
number_slider = Slider(10, range=1..20)

# ----
pt = ConstructPoint(XCoordinate=0, YCoordinate=0, ZCoordinate=0)

# ---- group: RH_IN:loops
number_slider_2 = Slider(48, range=1..100)

# ---- group: RH_IN:seed
number_slider_3 = Slider(1, range=1..5)

# ----
sph = Sphere(Base=pt, Radius=number_slider)
bbox = BoundingBox(Content=sph, Plane=PlaneXY(0, 0, 0), UnionBox=True)  # -> Box, Box_2
number_slider_4 = Slider(6, range=1..10)  # disabled
pop3d = Populate3D(Region=bbox.Box, Count=number_slider_2, Seed=number_slider_3)

# ---- group: RH_IN:planedir
list = ValueList({"1st": 0, "2nd": 2, "3rd": 4, "4th": 6, "5th": 8, "6th": 10}, selected="4th")

# ----
ln = Line(StartPoint=pt, EndPoint=pop3d)
division = Division(A=list, B=10)
pframe = PerpFrame(Curve=ln, Parameter=division)

# ---- group: RH_IN:radius2
toggle = BooleanToggle(False)

# ----
number_slider_5 = Slider(1, range=1..4)  # disabled
sec = BrepPlane(Brep=sph, Plane=pframe)  # -> Curves, Points
panel = Panel("""0.2
0.4""")
item = ListItem(List=panel, Index=toggle, Wrap=True)
division_2 = Division(A=number_slider_5, B=10)  # disabled
mpipe = MeshPipe(Curve=flatten(sec.Curves), Radius=item, Accuracy=0.2, Rotation=0, Segments=10, Caps=2)
medges = MeshEdges(Mesh=mpipe)  # -> NakedEdges, InteriorEdges, NonManifoldEdges

# ---- group: RH_OUT:edges
crv = Curve(medges.InteriorEdges)

# ---- group: RH_OUT:mesh
mesh = Mesh(mpipe)
