# Grasshopper definition Final_project.gh (Grasshopper 1.0.7)

size = GetNumber(Slider(100, range=50..100), AtLeast=1, AtMost=2147483647, Maximum=1.797693135e+308, Minimum=-1.797693135e+308)

panel_no = GetNumber(
    Slider(230, range=100..400),
    AtLeast=1,
    AtMost=2147483647,
    Maximum=1.797693135e+308,
    Minimum=-1.797693135e+308,
    Prompt="panel_no")

randomize = GetNumber(
    Slider(1, range=1..20),
    AtLeast=1,
    AtMost=2147483647,
    Maximum=1.797693135e+308,
    Minimum=-1.797693135e+308,
    Prompt="panel_no")

sqgrid = Square(Plane=PlaneXY(0, 0, 0), Size=Slider(10, range=0..10), ExtentX=Slider(20, range=0..100), ExtentY=Slider(10, range=0..100))  # -> Cells, Points

multiplication = Multiplication(A=size, B=2)
rectangle = Rectangle(Plane=PlaneXY(0, 0, 0), XSize=size, YSize=multiplication, Radius=0)  # -> Rectangle, Length

pt = Point([<point referenced from the Rhino model> x6])
points = GetPoint(pt, AtLeast=1, AtMost=2147483647, Realtime=True)

pop2d = Populate2D(Region=rectangle.Rectangle, Count=panel_no, Seed=randomize)
voronoi = Voronoi(Points=pop2d, Boundary=rectangle.Rectangle, BruteForceOverride=False)

pull = PullPoint(Point=flatten(pop2d), Geometry=points, ClosestOnly=True)  # -> ClosestPoint, Distance
bnd = Bounds(Numbers=flatten(pull.Distance))
bnd_2 = Bounds(Numbers=flatten(pull.Distance))
dom = ConstructDomain(DomainStart=Slider(8, range=0..10), DomainEnd=Slider(37, range=0..60))
dom_2 = ConstructDomain(DomainStart=Slider(0.95, range=0.01..0.99), DomainEnd=Slider(0.05, range=0.01..0.99))
remap = RemapNumbers(Value=pull.Distance, Source=bnd, Target=dom)  # -> Mapped, Clipped
remap_2 = RemapNumbers(Value=pull.Distance, Source=bnd_2, Target=dom_2)  # -> Mapped, Clipped

Z = UnitZ(Factor=remap.Mapped)
move = Move(Geometry=voronoi, Motion=Z)  # -> Geometry, Transform

tree_height = GetNumber(Slider(5, range=5..9), AtLeast=1, AtMost=2147483647, Maximum=1.797693135e+308, Minimum=-1.797693135e+308)

area = Area(Geometry=move.Geometry)  # -> Area, Centroid
scale = Scale(Geometry=move.Geometry, Center=area.Centroid, Factor=remap_2.Mapped)  # -> Geometry, Transform

panel = Panel("https://www.energyplus.net/weather-download/europe_wmo_region_6/ESP//ESP_Barcelona.081810_IWEC/all")
division = Division(A=tree_height, B=10)
downloadepw = LBDownloadWeather(weather_URL=panel)  # -> epw_file, stat_file, ddy_file; plug-in component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
importepw = LBImportEPW(epw_file=downloadepw.epw_file)  # -> location, dry_bulb_temperature, dew_point_temperature, relative_humidity, wind_speed, wind_direction, direct_normal_rad, diffuse_horizontal_rad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; plug-in component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

month = GetNumber(
    Slider(3, range=1..12),
    AtLeast=1,
    AtMost=2147483647,
    Maximum=1.797693135e+308,
    Minimum=-1.797693135e+308,
    Prompt="month")

day = GetNumber(Slider(21, range=1..31), AtLeast=1, AtMost=2147483647, Maximum=1.797693135e+308, Minimum=-1.797693135e+308)

analysisperiod = LBAnalysisPeriod(start_month=month, start_day=day, start_hour=0, end_month=month, end_day=day)  # -> period, hoys, dates; plug-in component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
sunpath = LBSunPath(location=importepw.location, hoys=analysisperiod.hoys, scale=1)  # -> report, vectors, altitudes, azimuths, hoys, sun_pts, analemma, daily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; plug-in component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
material = CreateMaterial(Diffuse=RGB(255, 105, 180), Specular=RGB(255, 255, 255), Emission=RGB(0, 0, 0), Transparency=0, Shine=0)
number_slider = Slider(5, range=0..10)
number_slider_2 = Slider(5, range=0..10)

# ---- group: RH_OUT:glass
mesh = Mesh(scale.Geometry)

# ----
division_2 = Division(A=number_slider, B=2)
skymatrix = LBCumulativeSkyMatrix(
    location=importepw.location,
    direct_rad=importepw.direct_normal_rad,
    diffuse_rad=importepw.diffuse_horizontal_rad,
    hoys=analysisperiod.hoys)  # -> report, sky_mtx; plug-in component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

preview = CustomPreview(Geometry=mesh, Material=ColourSwatch(SwatchColor=RGBA(97, 255, 255, 133)))

# ---- group: RH_IN:shadow
toggle = BooleanToggle(False)

# ----
panel_2 = Panel("""3
5""")
item = ListItem(List=panel_2, Index=toggle, Wrap=True)
colrange = LBColorRange(index=item)  # -> colors; plug-in component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
colrange_2 = LBColorRange(index=Slider(1, range=0..10))  # -> colors; plug-in component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
legendpar = LBLegendParameters(colors=colrange)  # -> leg_par; plug-in component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
legendpar_2 = LBLegendParameters(colors=colrange_2)  # -> leg_par; plug-in component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
number_slider_3 = Slider(0.01, range=0..0.01)
number_slider_4 = Slider(4, range=0.5..4)

# ---- group: RH_IN:run_sun
toggle_2 = BooleanToggle(False)

# ---- group: RH_IN:run_rad
toggle_3 = BooleanToggle(False)

# ----
srf = Surface(move.Geometry)

srf_2 = Surface(rectangle.Rectangle)
project = ProjectPoint(Point=area.Centroid, Direction=Vector(0, 0, -1), Geometry=srf_2)  # -> Point, Index
ln = Line(StartPoint=project.Point, EndPoint=area.Centroid)
eval = EvaluateCurve(Curve=ln, Parameter=division)  # -> Point, Tangent, Angle
ln_2 = Line(StartPoint=project.Point, EndPoint=eval.Point)

area_2 = Area(Geometry=srf_2)  # -> Area, Centroid
scale_nu = ScaleNU(Geometry=srf_2, Plane=area_2.Centroid, ScaleX=number_slider, ScaleY=division_2, ScaleZ=1)  # -> Geometry, Transform
directsunhours = LBDirectSunHours(
    vectors=flatten(sunpath.vectors),
    geometry=flatten(scale_nu.Geometry),
    context=flatten(srf),
    grid_size=number_slider_4,
    offset_dist=number_slider_3,
    legend_par=legendpar,
    parallel=toggle_2,
    run=toggle_2)  # -> report, points, results, mesh, legend, title, int_mtx; plug-in component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
incidentradiation = LBIncidentRadiation(
    sky_mtx=skymatrix.sky_mtx,
    geometry=flatten(scale_nu.Geometry),
    context=flatten(srf),
    grid_size=number_slider_4,
    offset_dist=number_slider_3,
    legend_par=legendpar_2,
    parallel=toggle_3,
    run=toggle_3)  # -> report, points, results, total, mesh, legend, title, int_mtx; plug-in component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
avr = Average(Input=directsunhours.results)
avr_2 = Average(Input=incidentradiation.results)
ma = MassAddition(Input=directsunhours.results)  # -> Result, PartialResults

# ---- group: RH_OUT:sunlight.legend
geo = Geometry(directsunhours.legend)

# ---- group: RH_OUT:sunlight.title
geo_2 = Geometry(directsunhours.title)

# ---- group: RH_OUT:sunlight.avg.hours
data = Data(avr)

# ---- group: RH_OUT:sunlight.mesh.map
mesh_2 = Mesh(directsunhours.mesh)

# ---- group: RH_OUT:radiation.avg
data_2 = Data(avr_2)

# ---- group: RH_OUT:radiation.mesh.map
mesh_3 = Mesh(incidentradiation.mesh)

# ---- group: RH_OUT:radiation.legend
geo_3 = Geometry(incidentradiation.legend)

# ---- group: RH_OUT:radiation.title
geo_4 = Geometry(incidentradiation.title)

# ---- group: RH_OUT:sunlight.total.hours
data_3 = Data(ma.Result)

# ---- group: RH_OUT:radiation.total
data_4 = Data(incidentradiation.total)

# ----
rulesrf = RuledSurface(CurveA=move.Geometry, CurveB=scale.Geometry)

popgeo = PopulateGeometry(Geometry=rulesrf, Count=Slider(5, range=4..8), Seed=1)
ln_3 = Line(StartPoint=graft(eval.Point), EndPoint=popgeo)

number_slider_5 = Slider(0, range=0..2)
number_slider_6 = Slider(0.05, range=0..0.1)
vpipe = PipeVariable(
    Curve=ln_3,
    Parameters=[Slider(0, range=0..100), Slider(1, range=0..1)],
    Radii=[Slider(0.2, range=0..1), Slider(0.1, range=0..1)],
    Caps=number_slider_5)  # -> simplify(Pipe)
vpipe_2 = PipeVariable(
    Curve=ln_2,
    Parameters=[Slider(0, range=0..100), Slider(1, range=0..1)],
    Radii=[Slider(0.5, range=0..1), Slider(0.2, range=0..1)],
    Caps=number_slider_5)

srf_3 = Surface(rulesrf)
srf_4 = Surface([vpipe, vpipe_2])
mesh_4 = MeshBrep(
    Brep=srf_4,
    Settings={GridMaxCount=0, GridMinCount=16, JaggedSeams=False, MaxEdgeLength=0, MinEdgeLength=0.0001, MinTolerance=0, Refine=True, RefineAngle=0, RelativeTolerance=0.65, SimplePlanes=True, Tolerance=0})  # disabled
mesh_uv = MeshSurface(Surface=srf_4, UCount=5, VCount=5, Overhang=True, Equalize=False)
mesh_5 = MeshBrep(
    Brep=srf_3,
    Settings={GridMaxCount=0, GridMinCount=16, JaggedSeams=False, MaxEdgeLength=0, MinEdgeLength=0.0001, MinTolerance=0, Refine=True, RefineAngle=0, RelativeTolerance=0.65, SimplePlanes=True, Tolerance=0})

# ---- group: RH_OUT:stem
mesh_6 = Mesh(mesh_uv)

# ---- group: RH_OUT:panels
mesh_7 = Mesh(mesh_5)

# ----
preview_2 = CustomPreview(Geometry=mesh_6, Material=ColourSwatch(SwatchColor=RGBA(112, 20, 20, 107)))

preview_3 = CustomPreview(Geometry=mesh_7, Material=ColourSwatch(SwatchColor=RGB(224, 224, 224)))
