# Grasshopper definition Forrest.Pavilion.gh (Grasshopper 1.0.7)

base_geometry_size = GetNumber(Slider(100, range=50..100), AtLeast=1, AtMost=2147483647, Maximum=1.797693135e+308, Minimum=-1.797693135e+308)

no_of_panels = GetNumber(
    Slider(230, range=100..400),
    AtLeast=1,
    AtMost=2147483647,
    Maximum=1.797693135e+308,
    Minimum=-1.797693135e+308,
    Prompt="panel_no")

randomization = GetNumber(
    Slider(1, range=1..20),
    AtLeast=1,
    AtMost=2147483647,
    Maximum=1.797693135e+308,
    Minimum=-1.797693135e+308,
    Prompt="panel_no")

attractor_points_variability = GetNumber(
    Slider(6, range=0..10),
    AtLeast=1,
    AtMost=2147483647,
    Maximum=1.797693135e+308,
    Minimum=-1.797693135e+308,
    Prompt="panel_no")

sqgrid = Square(Plane=PlaneXY(0, 0, 0), Size=Slider(10, range=0..10), ExtentX=Slider(20, range=0..100), ExtentY=Slider(10, range=0..100))  # -> Cells, Points

multiplication = Multiplication(A=base_geometry_size, B=2)
rectangle = Rectangle(Plane=PlaneXY(0, 0, 0), XSize=base_geometry_size, YSize=multiplication, Radius=0)  # -> Rectangle, Length

srf = Surface(rectangle.Rectangle)

pop2d = Populate2D(Region=rectangle.Rectangle, Count=no_of_panels, Seed=randomization)
voronoi = Voronoi(Points=pop2d, Boundary=rectangle.Rectangle, BruteForceOverride=False)

smallest_panel_height = GetNumber(Slider(8, range=5..15), AtLeast=1, AtMost=2147483647, Maximum=1.797693135e+308, Minimum=-1.797693135e+308)
largest_panel_height = GetNumber(Slider(37, range=25..45), AtLeast=1, AtMost=2147483647, Maximum=1.797693135e+308, Minimum=-1.797693135e+308)
largest_solid_panel = GetNumber(Slider(5, range=5..40), AtLeast=1, AtMost=2147483647, Maximum=1.797693135e+308, Minimum=-1.797693135e+308)
smallest_solid_panel = GetNumber(Slider(95, range=65..95), AtLeast=1, AtMost=2147483647, Maximum=1.797693135e+308, Minimum=-1.797693135e+308)
popgeo = PopulateGeometry(Geometry=srf, Count=Slider(3, range=0..10), Seed=attractor_points_variability)
division = Division(A=largest_solid_panel, B=100)
division_2 = Division(A=smallest_solid_panel, B=100)

pull = PullPoint(Point=flatten(pop2d), Geometry=popgeo, ClosestOnly=True)  # -> ClosestPoint, Distance
bnd = Bounds(Numbers=flatten(pull.Distance))
bnd_2 = Bounds(Numbers=flatten(pull.Distance))
dom = ConstructDomain(DomainStart=smallest_panel_height, DomainEnd=largest_panel_height)
dom_2 = ConstructDomain(DomainStart=division_2, DomainEnd=division)
remap = RemapNumbers(Value=pull.Distance, Source=bnd, Target=dom)  # -> Mapped, Clipped
remap_2 = RemapNumbers(Value=pull.Distance, Source=bnd_2, Target=dom_2)  # -> Mapped, Clipped

Z = UnitZ(Factor=remap.Mapped)
move = Move(Geometry=voronoi, Motion=Z)  # -> Geometry, Transform

tree_starting_point = GetNumber(Slider(5, range=5..9), AtLeast=1, AtMost=2147483647, Maximum=1.797693135e+308, Minimum=-1.797693135e+308)

panel = Panel("http://climate.onebuilding.org/WMO_Region_4_North_and_Central_America/USA_United_States_of_America/WI_Wisconsin/USA_WI_Madison-Dane.County.Rgnl.AP-Truax.Field.726410_TMY3.zip")

area = Area(Geometry=move.Geometry)  # -> Area, Centroid
scale = Scale(Geometry=move.Geometry, Center=area.Centroid, Factor=remap_2.Mapped)  # -> Geometry, Transform

downloadepw = LBDownloadWeather(weather_URL=panel)  # -> epw_file, stat_file, ddy_file; plug-in component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
division_3 = Division(A=tree_starting_point, B=10)

rulesrf = RuledSurface(CurveA=move.Geometry, CurveB=scale.Geometry)

project = ProjectPoint(Point=area.Centroid, Direction=Vector(0, 0, -1), Geometry=srf)  # -> Point, Index
ln = Line(StartPoint=project.Point, EndPoint=area.Centroid)
eval = EvaluateCurve(Curve=ln, Parameter=division_3)  # -> Point, Tangent, Angle
popgeo_2 = PopulateGeometry(Geometry=rulesrf, Count=Slider(5, range=4..8), Seed=1)
ln_2 = Line(StartPoint=graft(eval.Point), EndPoint=popgeo_2)
ln_3 = Line(StartPoint=project.Point, EndPoint=eval.Point)

importepw = LBImportEPW(epw_file=downloadepw.epw_file)  # -> location, dry_bulb_temperature, dew_point_temperature, relative_humidity, wind_speed, wind_direction, direct_normal_rad, diffuse_horizontal_rad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; plug-in component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

analysis_month = GetNumber(
    Slider(3, range=1..12),
    AtLeast=1,
    AtMost=2147483647,
    Maximum=1.797693135e+308,
    Minimum=-1.797693135e+308,
    Prompt="month")

analysis_day = GetNumber(Slider(21, range=1..31), AtLeast=1, AtMost=2147483647, Maximum=1.797693135e+308, Minimum=-1.797693135e+308)

number_slider = Slider(0, range=0..2)
number_slider_2 = Slider(0.05, range=0..0.1)
vpipe = PipeVariable(
    Curve=ln_2,
    Parameters=[Slider(0, range=0..100), Slider(1, range=0..1)],
    Radii=[Slider(0.2, range=0..1), Slider(0.1, range=0..1)],
    Caps=number_slider)  # -> simplify(Pipe)
vpipe_2 = PipeVariable(
    Curve=ln_3,
    Parameters=[Slider(0, range=0..100), Slider(1, range=0..1)],
    Radii=[Slider(0.5, range=0..1), Slider(0.2, range=0..1)],
    Caps=number_slider)

analysisperiod = LBAnalysisPeriod(start_month=analysis_month, start_day=analysis_day, start_hour=0, end_month=analysis_month, end_day=analysis_day)  # -> period, hoys, dates; plug-in component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
sunpath = LBSunPath(location=importepw.location, hoys=analysisperiod.hoys, scale=1)  # -> report, vectors, altitudes, azimuths, hoys, sun_pts, analemma, daily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; plug-in component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
srf_2 = Surface(rulesrf)
srf_3 = Surface([vpipe, vpipe_2])
mesh = Mesh(scale.Geometry)
mesh_2 = MeshBrep(
    Brep=srf_2,
    Settings={GridMaxCount=0, GridMinCount=16, JaggedSeams=False, MaxEdgeLength=0, MinEdgeLength=0.0001, MinTolerance=0, Refine=True, RefineAngle=0, RelativeTolerance=0.65, SimplePlanes=True, Tolerance=0})
number_slider_3 = Slider(5, range=0..10)
number_slider_4 = Slider(5, range=0..10)
mesh_uv = MeshSurface(Surface=srf_3, UCount=5, VCount=5, Overhang=True, Equalize=False)
area_2 = Area(Geometry=srf)  # -> Area, Centroid
mcol = MeshColours(Mesh=mesh_uv, Colours=ColourSwatch(SwatchColor=RGBA(112, 20, 20, 107)))  # -> flatten(Mesh)
mcol_2 = MeshColours(Mesh=mesh, Colours=ColourSwatch(SwatchColor=RGBA(63, 166, 166, 133)))
mcol_3 = MeshColours(Mesh=mesh_2, Colours=ColourSwatch(SwatchColor=RGB(92, 15, 66)))
division_4 = Division(A=number_slider_3, B=2)
mjoin = MeshJoin(Meshes=mcol)
mjoin_2 = MeshJoin(Meshes=mcol_2)
mjoin_3 = MeshJoin(Meshes=mcol_3)
scale_nu = ScaleNU(Geometry=srf, Plane=area_2.Centroid, ScaleX=number_slider_3, ScaleY=division_4, ScaleZ=1)  # -> Geometry, Transform
skymatrix = LBCumulativeSkyMatrix(
    location=importepw.location,
    direct_rad=importepw.direct_normal_rad,
    diffuse_rad=importepw.diffuse_horizontal_rad,
    hoys=analysisperiod.hoys)  # -> report, sky_mtx; plug-in component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
mesh_3 = Mesh(mjoin)
mesh_4 = Mesh(mjoin_2)
mesh_5 = Mesh(mjoin_3)
mjoin_4 = MeshJoin(Meshes=[mesh_4, mesh_3, mesh_5])  # -> flatten(Mesh)

# ---- group: RH_IN: Shadow Study
toggle = BooleanToggle(False)

# ----
panel_2 = Panel("""3
5""")
number_slider_5 = Slider(1, range=0..2)
number_slider_6 = Slider(11, range=0..100)
item = ListItem(List=panel_2, Index=toggle, Wrap=True)
colrange = LBColorRange(index=item)  # -> colors; plug-in component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
colrange_2 = LBColorRange(index=Slider(1, range=0..10))  # -> colors; plug-in component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
legendpar = LBLegendParameters(seg_count=number_slider_6, colors=colrange, num_decimals=number_slider_5)  # -> leg_par; plug-in component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
legendpar_2 = LBLegendParameters(seg_count=number_slider_6, colors=colrange_2, num_decimals=number_slider_5)  # -> leg_par; plug-in component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
number_slider_7 = Slider(0.01, range=0..0.01)
number_slider_8 = Slider(4, range=0.5..4)

# ---- group: RH_IN: Sunlight hours study
toggle_2 = BooleanToggle(False)

# ---- group: RH_IN: Radiation Analysis
toggle_3 = BooleanToggle(False)

# ----
srf_4 = Surface(rulesrf)
directsunhours = LBDirectSunHours(
    vectors=flatten(sunpath.vectors),
    geometry=flatten(scale_nu.Geometry),
    context=flatten(srf_4),
    grid_size=number_slider_8,
    offset_dist=number_slider_7,
    legend_par=legendpar,
    parallel=toggle_2,
    run=toggle_2)  # -> report, points, results, mesh, legend, title, int_mtx; plug-in component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
incidentradiation = LBIncidentRadiation(
    sky_mtx=skymatrix.sky_mtx,
    geometry=flatten(scale_nu.Geometry),
    context=flatten(srf_4),
    grid_size=number_slider_8,
    offset_dist=number_slider_7,
    legend_par=legendpar_2,
    parallel=toggle_3,
    run=toggle_3)  # -> report, points, results, total, mesh, legend, title, int_mtx; plug-in component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
number_slider_9 = Slider(0, range=0..1)
number_slider_10 = Slider(0, range=0..1)
item_2 = ListItem(List=directsunhours.legend, Index=number_slider_9, Wrap=True)
cull_i = CullIndex(List=directsunhours.legend, Indices=number_slider_9, Wrap=True)
item_3 = ListItem(List=incidentradiation.legend, Index=number_slider_10, Wrap=True)
cull_i_2 = CullIndex(List=incidentradiation.legend, Indices=number_slider_10, Wrap=True)
avr = Average(Input=directsunhours.results)
avr_2 = Average(Input=incidentradiation.results)

# ---- group: RH_OUT:sunlight.avg.hours
int = Integer(avr)

# ----
mesh_6 = Mesh(directsunhours.mesh)
mesh_7 = Mesh(item_2)

# ---- group: RH_OUT:radiation.avg
int_2 = Integer(avr_2)

# ----
mesh_8 = Mesh([incidentradiation.mesh, item_3])
mesh_9 = Mesh(item_3)

# ---- group: RH_OUT:radiation.total
int_3 = Integer(incidentradiation.total)

# ----
mjoin_5 = MeshJoin(Meshes=[mesh_6, mesh_7, mesh_8, mesh_9])
concat = Concatenate(FragmentA="Total Radiation  ", FragmentB=int_3)
concat_2 = Concatenate(FragmentA="Average Sunlight hours/radiation  ", FragmentB=[avr, avr_2])
bool = Boolean(True)
pt = Point(Point(-1.69045623, -62.54478874, 0))
bool_2 = Boolean(True)
bool_3 = Boolean(True)
mesh_10 = Mesh(mjoin_4)
pt_2 = Point(Point(-1.69045623, -43.43676618, 0))
pt_3 = Point([Point(322, 375, 0), Point(351, -133, 0), Point(351, -88, 0), Point(351, -41, 0), Point(351, 4, 0), Point(351, 49, 0), Point(351, 94, 0), Point(351, 140, 0), Point(351, 185, 0), Point(351, 230, 0), Point(351, 275, 0), Point(351, 320, 0)])
mesh_11 = Mesh(mjoin_5)
M = MeshToBase64Draco(mesh=mesh_11)  # -> base64Draco; inputs mesh: Mesh
# ---------- M: C# ----------
    var options = new Rhino.FileIO.DracoCompressionOptions();
    options.CompressionLevel = 5;
    options.IncludeTextureCoordinates = false;
    options.IncludeVertexColors = false;

    var compressed = Rhino.FileIO.DracoCompression.Compress(mesh, options);
    base64Draco = compressed.ToBase64String();
# ---------- end M ----------
M_2 = MeshToBase64Draco(mesh=mesh_10)  # -> base64Draco; inputs mesh: Mesh; same code as M
c_script = CSharpScript(face="Verdana", bold=bool, size=Slider(4.52, range=0..11), content=concat, pl=pt)  # -> out, A; inputs face: String, bold: Boolean, italics: Boolean, size: Double, content: String, pl: Plane
# ---------- c_script: C# usings ----------
using System.IO;
using System.Linq;
using System.Data;
using System.Drawing;
using System.Reflection;
using System.Windows.Forms;
using System.Xml;
using System.Xml.Linq;
using System.Runtime.InteropServices;

using Rhino.DocObjects;
using Rhino.Collections;
using GH_IO;
using GH_IO.Serialization;
# ---------- c_script: C# ----------
    if(size == 0)
      size = 1;

    if(!string.IsNullOrEmpty(face) && size > 0 && !string.IsNullOrEmpty(content) &&
      pl.IsValid)
    {
      using (var doc = Rhino.RhinoDoc.CreateHeadless(null))
      {
        var te = doc.Objects.AddText(content, pl, size, face, bold, italics);
        var txt = doc.Objects.Find(te) as Rhino.DocObjects.TextObject;

        if(txt != null)
        {
          var tt = txt.Geometry as Rhino.Geometry.TextEntity;
          A = tt.Explode();
        }
      }
    }
# ---------- end c_script ----------
c_script_2 = CSharpScript(face="Verdana", bold=bool_2, size=Slider(4.52, range=0..11), content=concat_2, pl=pt_2)  # -> out, A; inputs face: String, bold: Boolean, italics: Boolean, size: Double, content: String, pl: Plane; same code as c_script
c_script_3 = CSharpScript(face="Verdana", bold=bool_3, size=Slider(11, range=0..11), content=[cull_i, cull_i_2], pl=pt_3)  # -> out, A; inputs face: String, bold: Boolean, italics: Boolean, size: Double, content: String, pl: Plane; same code as c_script
Z_2 = UnitZ(Factor=Slider(0.1, range=0..0.1))
move_2 = Move(Geometry=[c_script.A, c_script_2.A, c_script_3.A], Motion=Z_2)  # -> Geometry, Transform

# ---- group: RH_OUT:text_lines
crv = Curve(move_2.Geometry)

# ---- group: RH_OUT:Analysis.mesh.output
txt = Text(M)

# ---- group: RH_OUT:geometry
txt_2 = Text(M_2)
